# Grasshopper definition Grasshopper Post.gh (Grasshopper 1.0.8)

# ----
# 2D contour cutting
c_script = CSharpScript()  # -> operationLines; inputs curve: Curve, depth: Double, plungeZ: Double, tolerance: Double, toolNr: Int32, feedFactor: Double, toolType: String, stepdown: Double
# ---------- c_script: C# ----------
// HopContour -- 2D contour cutting component for DYNESTIC CNC
// Inputs: curve (Item), depth (Item), plungeZ (Item), tolerance (Item),
//         toolNr (Item), feedFactor (Item), toolType (Item), stepdown (Item)
// Outputs: operationLines
//
// Converts Grasshopper curves (NURBS, arcs, polylines) into NC-Hops 2D contour
// macro blocks: SP / G01 / G03M / G02M / EP.
// True arcs are detected via Curve.ToArcsAndLines and emitted as G03M (CCW) or G02M (CW).
// Output wires into HopExport.cs operationLines input.

using System;
using System.Collections;
using System.Collections.Generic;
using System.Drawing;
using System.Globalization;

using Rhino;
using Rhino.Geometry;

using Grasshopper;
using Grasshopper.Kernel;
using Grasshopper.Kernel.Data;
using Grasshopper.Kernel.Types;

public class Script_Instance : GH_ScriptInstance
{
  private void RunScript(
		Curve curve,
		double depth,
		double plungeZ,
		double tolerance,
		int toolNr,
		double feedFactor,
		string toolType,
		double stepdown,
		ref object operationLines)
  {
    // ---------------------------------------------------------------
    // 1. DEFAULTS -- downstream gets these if guards trigger
    // ---------------------------------------------------------------
    operationLines = new List<string>();

    // ---------------------------------------------------------------
    // 2. GUARDS -- required input validation
    // ---------------------------------------------------------------
    if (curve == null)
    {
      this.Component.AddRuntimeMessage(
        GH_RuntimeMessageLevel.Error, "No curve connected");
      return;
    }

    if (toolNr <= 0)
    {
      this.Component.AddRuntimeMessage(
        GH_RuntimeMessageLevel.Error, "toolNr is required and must be > 0");
      return;
    }

    // ---------------------------------------------------------------
    // 3. INPUT DEFAULTS -- fallback for disconnected inputs
    // ---------------------------------------------------------------
    if (feedFactor <= 0) feedFactor = 1.0;
    if (string.IsNullOrEmpty(toolType)) toolType = "WZF";
    if (tolerance <= 0) tolerance = 0.1;
    if (depth <= 0) depth = 1.0;
    if (plungeZ <= 0) plungeZ = depth;

    // ---------------------------------------------------------------
    // 4. PLANARITY CHECK
    // ---------------------------------------------------------------
    if (!curve.IsPlanar())
    {
      this.Component.AddRuntimeMessage(
        GH_RuntimeMessageLevel.Error, "Curve is not planar -- cannot use for 2D contour");
      return;
    }
    BoundingBox curveBB = curve.GetBoundingBox(true);
    if (Math.Abs(curveBB.Max.Z - curveBB.Min.Z) > tolerance)
    {
      this.Component.AddRuntimeMessage(
        GH_RuntimeMessageLevel.Warning,
        "Curve has Z variation -- using XY projection for 2D contour");
    }

    // ---------------------------------------------------------------
    // 5. CURVE DECOMPOSITION -- arcs and lines via RhinoCommon
    // ---------------------------------------------------------------
    PolyCurve pc = curve.ToArcsAndLines(tolerance, 0.1, 0.0, 0.0) as PolyCurve;
    if (pc == null)
    {
      this.Component.AddRuntimeMessage(
        GH_RuntimeMessageLevel.Error, "Curve conversion to arcs and lines failed");
      return;
    }

    // ---------------------------------------------------------------
    // 6. BUILD TOOL CALL -- first line of output per D-13
    // ---------------------------------------------------------------
    List<string> lines = new List<string>();
    string toolCall = toolType + " (" + toolNr.ToString()
      + ",_VE,_V*" + feedFactor.ToString(CultureInfo.InvariantCulture)
      + ",_VA,_SD,0,'')";
    lines.Add(toolCall);

    // ---------------------------------------------------------------
    // 7. MULTI-PASS OR SINGLE-PASS
    // ---------------------------------------------------------------
    if (stepdown > 0)
    {
      // Multi-pass: split depth into stepdown increments
      int passCount = (int)Math.Ceiling(depth / stepdown);
      for (int p = 0; p < passCount; p++)
      {
        double passDepth = Math.Min((p + 1) * stepdown, depth);
        BuildContourBlock(lines, pc, -Math.Abs(passDepth));
      }
    }
    else
    {
      // Single pass at full depth; SP z_eintauch uses plungeZ
      BuildContourBlock(lines, pc, -Math.Abs(plungeZ));
    }

    // ---------------------------------------------------------------
    // 8. OUTPUT + REMARK
    // ---------------------------------------------------------------
    int arcCount = 0;
    int lineCount = 0;
    for (int i = 0; i < pc.SegmentCount; i++)
    {
      Curve seg = pc.SegmentCurve(i);
      ArcCurve arcCheck = seg as ArcCurve;
      if (arcCheck != null)
      {
        arcCount++;
      }
      else
      {
        lineCount++;
      }
    }
    this.Component.AddRuntimeMessage(
      GH_RuntimeMessageLevel.Remark,
      "Contour: " + pc.SegmentCount.ToString() + " segments ("
        + arcCount.ToString() + " arcs, " + lineCount.ToString() + " lines), depth="
        + (-Math.Abs(depth)).ToString(CultureInfo.InvariantCulture));

    operationLines = lines;
  }

  // ---------------------------------------------------------------
  // HELPER: Build one SP...moves...EP contour block at a given Z
  // ---------------------------------------------------------------
  private void BuildContourBlock(List<string> lines, PolyCurve pc, double zEintauch)
  {
    // SP (contour start)
    Point3d startPt = pc.PointAtStart;
    lines.Add("SP (" + startPt.X.ToString(CultureInfo.InvariantCulture) + ","
      + startPt.Y.ToString(CultureInfo.InvariantCulture) + ","
      + zEintauch.ToString(CultureInfo.InvariantCulture)
      + ",2,0,_ANF,0,0,0,0,0,0,0,0,0,0,0,0,0,0,0,0,0)");

    // Segment iteration: classify each as arc or line
    for (int i = 0; i < pc.SegmentCount; i++)
    {
      Curve seg = pc.SegmentCurve(i);

      ArcCurve arcSeg = seg as ArcCurve;
      if (arcSeg != null)
      {
        Arc arc = arcSeg.Arc;
        Point3d endPt = arc.EndPoint;
        Point3d center = arc.Center;
        bool isCCW = arc.Plane.Normal.Z >= 0;
        string cmd = isCCW ? "G03M" : "G02M";
        lines.Add(cmd + " ("
          + endPt.X.ToString(CultureInfo.InvariantCulture) + ","
          + endPt.Y.ToString(CultureInfo.InvariantCulture) + ",0,"
          + center.X.ToString(CultureInfo.InvariantCulture) + ","
          + center.Y.ToString(CultureInfo.InvariantCulture) + ",0,0,2,0)");
        continue;
      }

      LineCurve lineSeg = seg as LineCurve;
      if (lineSeg != null)
      {
        Point3d endPt = lineSeg.PointAtEnd;
        lines.Add("G01 ("
          + endPt.X.ToString(CultureInfo.InvariantCulture) + ","
          + endPt.Y.ToString(CultureInfo.InvariantCulture) + ",0,0,0,2)");
        continue;
      }

      // Fallback for any other segment type
      Point3d fallbackEnd = seg.PointAtEnd;
      lines.Add("G01 ("
        + fallbackEnd.X.ToString(CultureInfo.InvariantCulture) + ","
        + fallbackEnd.Y.ToString(CultureInfo.InvariantCulture) + ",0,0,0,2)");
    }

    // EP (contour end)
    lines.Add("EP (0,_ANF,0)");
  }
}
# ---------- end c_script ----------

# ----
# Free slot operation
c_script_2 = CSharpScript()  # -> operationLines; inputs p1: Point3d, p2: Point3d, slotWidth: Double, depth: Double, toolNr: Int32, feedFactor: Double, toolType: String
# ---------- c_script_2: C# ----------
// HopFreeSlot -- Free slot operation for DYNESTIC CNC
// Inputs: p1 (Item), p2 (Item), slotWidth (Item),
//         depth (Item), toolNr (Item), feedFactor (Item), toolType (Item)
// Outputs: operationLines
//
// Takes two Point3d inputs (slot start and end) plus slot width.
// Emits WZF tool call + CALL _nuten_frei_v5 macro for HopExport.

using System;
using System.Collections;
using System.Collections.Generic;
using System.Drawing;
using System.Globalization;

using Rhino;
using Rhino.Geometry;

using Grasshopper;
using Grasshopper.Kernel;
using Grasshopper.Kernel.Data;
using Grasshopper.Kernel.Types;

public class Script_Instance : GH_ScriptInstance
{
  private void RunScript(
		Point3d p1,
		Point3d p2,
		double slotWidth,
		double depth,
		int toolNr,
		double feedFactor,
		string toolType,
		ref object operationLines)
  {
    // ---------------------------------------------------------------
    // 1. DEFAULTS
    // ---------------------------------------------------------------
    operationLines = new List<string>();

    // ---------------------------------------------------------------
    // 2. GUARDS
    // ---------------------------------------------------------------
    if (toolNr <= 0)
    {
      this.Component.AddRuntimeMessage(
        GH_RuntimeMessageLevel.Error, "toolNr is required and must be > 0");
      return;
    }

    if (slotWidth <= 0)
    {
      this.Component.AddRuntimeMessage(
        GH_RuntimeMessageLevel.Error, "slotWidth must be > 0");
      return;
    }

    // ---------------------------------------------------------------
    // 3. INPUT DEFAULTS
    // ---------------------------------------------------------------
    if (feedFactor <= 0) feedFactor = 1.0;
    if (string.IsNullOrEmpty(toolType)) toolType = "WZF";
    if (depth <= 0) depth = 1.0;

    // ---------------------------------------------------------------
    // 4. BUILD TOOL CALL + MACRO
    // ---------------------------------------------------------------
    List<string> lines = new List<string>();
    lines.Add(toolType + " (" + toolNr.ToString()
      + ",_VE,_V*" + feedFactor.ToString(CultureInfo.InvariantCulture)
      + ",_VA,_SD,0,'')");

    double negDepth = -Math.Abs(depth);

    lines.Add("CALL _nuten_frei_v5(VAL "
      + "X1:=" + p1.X.ToString(CultureInfo.InvariantCulture) + ","
      + "Y1:=" + p1.Y.ToString(CultureInfo.InvariantCulture) + ","
      + "X2:=" + p2.X.ToString(CultureInfo.InvariantCulture) + ","
      + "Y2:=" + p2.Y.ToString(CultureInfo.InvariantCulture) + ","
      + "NB:=" + slotWidth.ToString(CultureInfo.InvariantCulture) + ","
      + "Tiefe:=" + negDepth.ToString(CultureInfo.InvariantCulture) + ","
      + "LAGE:=0,RK:=0,SPEGA:=0,EPEGA:=0,esmd:=0,esxy1:=0,esxy2:=0)");

    // ---------------------------------------------------------------
    // 5. OUTPUT
    // ---------------------------------------------------------------
    this.Component.AddRuntimeMessage(
      GH_RuntimeMessageLevel.Remark,
      "FreeSlot: (" + p1.X.ToString(CultureInfo.InvariantCulture)
      + "," + p1.Y.ToString(CultureInfo.InvariantCulture)
      + ") to (" + p2.X.ToString(CultureInfo.InvariantCulture)
      + "," + p2.Y.ToString(CultureInfo.InvariantCulture)
      + ") W=" + slotWidth.ToString(CultureInfo.InvariantCulture));

    operationLines = lines;
  }
}
# ---------- end c_script_2 ----------

# ----
# Vertical drilling
c_script_3 = CSharpScript()  # -> operationLines; inputs points: list of Point3d, zSurface: Double, depth: Double, diameter: Double, stepdown: Double, toolNr: Int32, feedFactor: Double, toolType: String
# ---------- c_script_3: C# ----------
// HopDrill -- Vertical drilling operation via Bohrung macro
// Inputs: points (List), zSurface (Item), depth (Item), diameter (Item),
//         stepdown (Item), toolNr (Item), feedFactor (Item), toolType (Item)
// Outputs: operationLines
//
// Converts a list of Grasshopper points into NC-Hops Bohrung macro strings.
// Each point becomes one Bohrung call with the specified depth and diameter.
// When stepdown > 0, drilling is split into multiple passes at increasing depths.
// Output wires into HopExport.cs operationLines input.

using System;
using System.Collections;
using System.Collections.Generic;
using System.Drawing;
using System.Globalization;

using Rhino;
using Rhino.Geometry;

using Grasshopper;
using Grasshopper.Kernel;
using Grasshopper.Kernel.Data;
using Grasshopper.Kernel.Types;

public class Script_Instance : GH_ScriptInstance
{
  private void RunScript(
		List<Point3d> points,
		double zSurface,
		double depth,
		double diameter,
		double stepdown,
		int toolNr,
		double feedFactor,
		string toolType,
		ref object operationLines)
  {
    // ---------------------------------------------------------------
    // 1. DEFAULTS -- downstream gets these if guards trigger
    // ---------------------------------------------------------------
    operationLines = new List<string>();

    // ---------------------------------------------------------------
    // 2. GUARDS -- required inputs
    // ---------------------------------------------------------------
    if (points == null || points.Count == 0)
    {
      this.Component.AddRuntimeMessage(
        GH_RuntimeMessageLevel.Error, "No drill points connected");
      return;
    }
    if (toolNr <= 0)
    {
      this.Component.AddRuntimeMessage(
        GH_RuntimeMessageLevel.Error, "toolNr is required and must be > 0");
      return;
    }

    // ---------------------------------------------------------------
    // 3. INPUT DEFAULTS -- fallback for disconnected optional inputs
    // ---------------------------------------------------------------
    if (feedFactor <= 0) feedFactor = 1.0;
    if (string.IsNullOrEmpty(toolType)) toolType = "WZB";
    if (depth <= 0) depth = 1.0;
    if (diameter <= 0) diameter = 8.0;

    // ---------------------------------------------------------------
    // 4. BUILD TOOL CALL -- first line of output per D-13
    // ---------------------------------------------------------------
    List<string> lines = new List<string>();
    string toolCall = toolType + " (" + toolNr.ToString()
      + ",_VE,_V*" + feedFactor.ToString(CultureInfo.InvariantCulture)
      + ",_VA,_SD,0,'')";
    lines.Add(toolCall);

    // ---------------------------------------------------------------
    // 5. MULTI-PASS OR SINGLE-PASS DRILLING
    // ---------------------------------------------------------------
    if (stepdown > 0)
    {
      // Multi-pass: split depth into incremental passes per D-11
      int passCount = (int)Math.Ceiling(depth / stepdown);
      for (int p = 0; p < passCount; p++)
      {
        double passDepth = Math.Min((p + 1) * stepdown, depth);
        double negPassDepth = -passDepth;
        for (int i = 0; i < points.Count; i++)
        {
          Point3d pt = points[i];
          lines.Add("Bohrung ("
            + pt.X.ToString(CultureInfo.InvariantCulture) + ","
            + pt.Y.ToString(CultureInfo.InvariantCulture) + ","
            + zSurface.ToString(CultureInfo.InvariantCulture) + ","
            + negPassDepth.ToString(CultureInfo.InvariantCulture) + ","
            + diameter.ToString(CultureInfo.InvariantCulture)
            + ",0,0,0,0,0,0,0)");
        }
      }
    }
    else
    {
      // Single pass at full depth per D-08
      double negDepth = -Math.Abs(depth);
      for (int i = 0; i < points.Count; i++)
      {
        Point3d pt = points[i];
        lines.Add("Bohrung ("
          + pt.X.ToString(CultureInfo.InvariantCulture) + ","
          + pt.Y.ToString(CultureInfo.InvariantCulture) + ","
          + zSurface.ToString(CultureInfo.InvariantCulture) + ","
          + negDepth.ToString(CultureInfo.InvariantCulture) + ","
          + diameter.ToString(CultureInfo.InvariantCulture)
          + ",0,0,0,0,0,0,0)");
      }
    }

    // ---------------------------------------------------------------
    // 6. OUTPUT + REMARK
    // ---------------------------------------------------------------
    this.Component.AddRuntimeMessage(
      GH_RuntimeMessageLevel.Remark,
      points.Count.ToString() + " drill points, depth=" + (-Math.Abs(depth)).ToString(CultureInfo.InvariantCulture)
      + ", diameter=" + diameter.ToString(CultureInfo.InvariantCulture));
    operationLines = lines;
  }
}
# ---------- end c_script_3 ----------

# ----
# Circular profile path
c_script_4 = CSharpScript()  # -> operationLines; inputs center: Point3d, radius: Double, radiusCorr: Int32, depth: Double, stepdown: Double, angle: Double, toolNr: Int32, feedFactor: Double, toolType: String
# ---------- c_script_4: C# ----------
// HopCircPath -- Circular profile path operation for DYNESTIC CNC
// Inputs: center (Item), radius (Item), radiusCorr (Item),
//         depth (Item), stepdown (Item), angle (Item),
//         toolNr (Item), feedFactor (Item), toolType (Item)
// Outputs: operationLines
//
// radiusCorr: 1 = inside, -1 = outside, 0 = center
// Emits WZF tool call + CALL _Kreisbahn_V5 macro for HopExport.

using System;
using System.Collections;
using System.Collections.Generic;
using System.Drawing;
using System.Globalization;

using Rhino;
using Rhino.Geometry;

using Grasshopper;
using Grasshopper.Kernel;
using Grasshopper.Kernel.Data;
using Grasshopper.Kernel.Types;

public class Script_Instance : GH_ScriptInstance
{
  private void RunScript(
		Point3d center,
		double radius,
		int radiusCorr,
		double depth,
		double stepdown,
		double angle,
		int toolNr,
		double feedFactor,
		string toolType,
		ref object operationLines)
  {
    // ---------------------------------------------------------------
    // 1. DEFAULTS
    // ---------------------------------------------------------------
    operationLines = new List<string>();

    // ---------------------------------------------------------------
    // 2. GUARDS
    // ---------------------------------------------------------------
    if (toolNr <= 0)
    {
      this.Component.AddRuntimeMessage(
        GH_RuntimeMessageLevel.Error, "toolNr is required and must be > 0");
      return;
    }

    if (radius <= 0)
    {
      this.Component.AddRuntimeMessage(
        GH_RuntimeMessageLevel.Error, "radius must be > 0");
      return;
    }

    // ---------------------------------------------------------------
    // 3. INPUT DEFAULTS
    // ---------------------------------------------------------------
    if (feedFactor <= 0) feedFactor = 1.0;
    if (string.IsNullOrEmpty(toolType)) toolType = "WZF";
    if (depth <= 0) depth = 1.0;
    if (angle <= 0) angle = 360.0;

    // ---------------------------------------------------------------
    // 4. BUILD TOOL CALL + MACRO
    // ---------------------------------------------------------------
    List<string> lines = new List<string>();
    lines.Add(toolType + " (" + toolNr.ToString()
      + ",_VE,_V*" + feedFactor.ToString(CultureInfo.InvariantCulture)
      + ",_VA,_SD,0,'')");

    double negDepth = -Math.Abs(depth);
    double zuTiefe = (stepdown > 0) ? stepdown : 0;

    lines.Add("CALL _Kreisbahn_V5(VAL "
      + "X_Mitte:=" + center.X.ToString(CultureInfo.InvariantCulture) + ","
      + "Y_Mitte:=" + center.Y.ToString(CultureInfo.InvariantCulture) + ","
      + "Tiefe:=" + negDepth.ToString(CultureInfo.InvariantCulture) + ","
      + "ZuTiefe:=" + zuTiefe.ToString(CultureInfo.InvariantCulture) + ","
      + "Radius:=" + radius.ToString(CultureInfo.InvariantCulture) + ","
      + "Radiuskorrektur:=" + radiusCorr.ToString() + ","
      + "AB:=1,Aufmass:=0,Bearb_umkehren:=1,"
      + "Winkel:=" + angle.ToString(CultureInfo.InvariantCulture) + ","
      + "ANF:=_ANF,ABF:=_ANF,Rampe:=1,Interpol:=0,esxy:=0,esmd:=0,laser:=0)");

    // ---------------------------------------------------------------
    // 5. OUTPUT
    // ---------------------------------------------------------------
    this.Component.AddRuntimeMessage(
      GH_RuntimeMessageLevel.Remark,
      "CircPath: R=" + radius.ToString(CultureInfo.InvariantCulture)
      + " corr=" + radiusCorr.ToString()
      + " angle=" + angle.ToString(CultureInfo.InvariantCulture));

    operationLines = lines;
  }
}
# ---------- end c_script_4 ----------

# ----
# Circular pocket
c_script_5 = CSharpScript()  # -> operationLines; inputs center: Point3d, radius: Double, depth: Double, stepdown: Double, toolNr: Int32, feedFactor: Double, toolType: String
# ---------- c_script_5: C# ----------
// HopCircPocket -- Circular pocket operation for DYNESTIC CNC
// Inputs: center (Item), radius (Item),
//         depth (Item), stepdown (Item),
//         toolNr (Item), feedFactor (Item), toolType (Item)
// Outputs: operationLines
//
// Emits WZF tool call + CALL _Kreistasche_V5 macro for HopExport.

using System;
using System.Collections;
using System.Collections.Generic;
using System.Drawing;
using System.Globalization;

using Rhino;
using Rhino.Geometry;

using Grasshopper;
using Grasshopper.Kernel;
using Grasshopper.Kernel.Data;
using Grasshopper.Kernel.Types;

public class Script_Instance : GH_ScriptInstance
{
  private void RunScript(
		Point3d center,
		double radius,
		double depth,
		double stepdown,
		int toolNr,
		double feedFactor,
		string toolType,
		ref object operationLines)
  {
    // ---------------------------------------------------------------
    // 1. DEFAULTS
    // ---------------------------------------------------------------
    operationLines = new List<string>();

    // ---------------------------------------------------------------
    // 2. GUARDS
    // ---------------------------------------------------------------
    if (toolNr <= 0)
    {
      this.Component.AddRuntimeMessage(
        GH_RuntimeMessageLevel.Error, "toolNr is required and must be > 0");
      return;
    }

    if (radius <= 0)
    {
      this.Component.AddRuntimeMessage(
        GH_RuntimeMessageLevel.Error, "radius must be > 0");
      return;
    }

    // ---------------------------------------------------------------
    // 3. INPUT DEFAULTS
    // ---------------------------------------------------------------
    if (feedFactor <= 0) feedFactor = 1.0;
    if (string.IsNullOrEmpty(toolType)) toolType = "WZF";
    if (depth <= 0) depth = 1.0;

    // ---------------------------------------------------------------
    // 4. BUILD TOOL CALL + MACRO
    // ---------------------------------------------------------------
    List<string> lines = new List<string>();
    lines.Add(toolType + " (" + toolNr.ToString()
      + ",_VE,_V*" + feedFactor.ToString(CultureInfo.InvariantCulture)
      + ",_VA,_SD,0,'')");

    double negDepth = -Math.Abs(depth);
    double zustellung = (stepdown > 0) ? stepdown : 0;

    lines.Add("CALL _Kreistasche_V5(VAL "
      + "X_Mitte:=" + center.X.ToString(CultureInfo.InvariantCulture) + ","
      + "Y_Mitte:=" + center.Y.ToString(CultureInfo.InvariantCulture) + ","
      + "Radius:=" + radius.ToString(CultureInfo.InvariantCulture) + ","
      + "Tiefe:=" + negDepth.ToString(CultureInfo.InvariantCulture) + ","
      + "Zustellung:=" + zustellung.ToString(CultureInfo.InvariantCulture) + ","
      + "AB:=2,ABF:=_ANF,Interpol:=0,umkehren:=0,esxy:=0,esmd:=0,laser:=0)");

    // ---------------------------------------------------------------
    // 5. OUTPUT
    // ---------------------------------------------------------------
    this.Component.AddRuntimeMessage(
      GH_RuntimeMessageLevel.Remark,
      "CircPocket: R=" + radius.ToString(CultureInfo.InvariantCulture)
      + " at (" + center.X.ToString(CultureInfo.InvariantCulture)
      + ", " + center.Y.ToString(CultureInfo.InvariantCulture) + ")");

    operationLines = lines;
  }
}
# ---------- end c_script_5 ----------

number_slider = Slider(250, range=0..1000)
Y = UnitY(Factor=number_slider)
rectangle = Rectangle(Plane=PlaneXY(0, 0, 0), XSize=Slider(500, range=0..1000), YSize=Slider(500, range=0..1000), Radius=0)  # -> Rectangle, Length
X = UnitX(Factor=number_slider)
move = Move(Geometry=rectangle.Rectangle, Motion=Y)  # -> Geometry, Transform
move_2 = Move(Geometry=move.Geometry, Motion=X)  # -> Geometry, Transform
number_slider_2 = Slider(1000, range=0..1000)

# ----
# Rectangular pocket
c_script_6 = CSharpScript(
    rectCurve=move_2.Geometry,
    cornerRadius=Slider(20, range=0..100),
    depth=Slider(10, range=0..10),
    toolNr=Slider(1, range=0..100))  # -> operationLines; inputs rectCurve: Curve, cornerRadius: Double, angle: Double, depth: Double, stepdown: Double, toolNr: Int32, feedFactor: Double, toolType: String
# ---------- c_script_6: C# ----------
// HopRectPocket -- Rectangular pocket operation for DYNESTIC CNC
// Inputs: rectCurve (Item), cornerRadius (Item), angle (Item),
//         depth (Item), stepdown (Item),
//         toolNr (Item), feedFactor (Item), toolType (Item)
// Outputs: operationLines
//
// Extracts center and dimensions from the rectangle curve bounding box.
// Emits WZF tool call + CALL _RechteckTasche_V5 macro for HopExport.

using System;
using System.Collections;
using System.Collections.Generic;
using System.Drawing;
using System.Globalization;

using Rhino;
using Rhino.Geometry;

using Grasshopper;
using Grasshopper.Kernel;
using Grasshopper.Kernel.Data;
using Grasshopper.Kernel.Types;

public class Script_Instance : GH_ScriptInstance
{
  private void RunScript(
		Curve rectCurve,
		double cornerRadius,
		double angle,
		double depth,
		double stepdown,
		int toolNr,
		double feedFactor,
		string toolType,
		ref object operationLines)
  {
    // ---------------------------------------------------------------
    // 1. DEFAULTS
    // ---------------------------------------------------------------
    operationLines = new List<string>();

    // ---------------------------------------------------------------
    // 2. GUARDS
    // ---------------------------------------------------------------
    if (rectCurve == null)
    {
      this.Component.AddRuntimeMessage(
        GH_RuntimeMessageLevel.Error, "No rectangle curve connected");
      return;
    }

    if (toolNr <= 0)
    {
      this.Component.AddRuntimeMessage(
        GH_RuntimeMessageLevel.Error, "toolNr is required and must be > 0");
      return;
    }

    // ---------------------------------------------------------------
    // 3. INPUT DEFAULTS
    // ---------------------------------------------------------------
    if (cornerRadius < 0) cornerRadius = 0;
    if (feedFactor <= 0) feedFactor = 1.0;
    if (string.IsNullOrEmpty(toolType)) toolType = "WZF";
    if (depth <= 0) depth = 1.0;

    // ---------------------------------------------------------------
    // 4. EXTRACT DIMENSIONS from BoundingBox
    // ---------------------------------------------------------------
    BoundingBox bb = rectCurve.GetBoundingBox(true);
    double cx = (bb.Min.X + bb.Max.X) / 2.0;
    double cy = (bb.Min.Y + bb.Max.Y) / 2.0;
    double width = bb.Max.X - bb.Min.X;
    double height = bb.Max.Y - bb.Min.Y;

    // ---------------------------------------------------------------
    // 5. BUILD TOOL CALL (first line)
    // ---------------------------------------------------------------
    List<string> lines = new List<string>();
    string toolCall = toolType + " (" + toolNr.ToString()
      + ",_VE,_V*" + feedFactor.ToString(CultureInfo.InvariantCulture)
      + ",_VA,_SD,0,'')";
    lines.Add(toolCall);

    // ---------------------------------------------------------------
    // 6. BUILD CALL MACRO
    // ---------------------------------------------------------------
    double negDepth = -Math.Abs(depth);
    double zustellung = (stepdown > 0) ? stepdown : 0;

    lines.Add("CALL _RechteckTasche_V5(VAL "
      + "x_Mitte:=" + cx.ToString(CultureInfo.InvariantCulture) + ","
      + "Y_Mitte:=" + cy.ToString(CultureInfo.InvariantCulture) + ","
      + "Taschenlaenge:=" + width.ToString(CultureInfo.InvariantCulture) + ","
      + "Taschenbreite:=" + height.ToString(CultureInfo.InvariantCulture) + ","
      + "Radius:=" + cornerRadius.ToString(CultureInfo.InvariantCulture) + ","
      + "Winkel:=" + angle.ToString(CultureInfo.InvariantCulture) + ","
      + "Tiefe:=" + negDepth.ToString(CultureInfo.InvariantCulture) + ","
      + "Zustellung:=" + zustellung.ToString(CultureInfo.InvariantCulture) + ","
      + "AB:=2,ABF:=_ANF,Interpol:=1,umkehren:=0,esxy:=0,esmd:=0,laser:=0)");

    // ---------------------------------------------------------------
    // 7. OUTPUT
    // ---------------------------------------------------------------
    this.Component.AddRuntimeMessage(
      GH_RuntimeMessageLevel.Remark,
      "RectPocket: " + width.ToString(CultureInfo.InvariantCulture)
      + " x " + height.ToString(CultureInfo.InvariantCulture)
      + " at (" + cx.ToString(CultureInfo.InvariantCulture)
      + ", " + cy.ToString(CultureInfo.InvariantCulture) + ")");

    operationLines = lines;
  }
}
# ---------- end c_script_6 ----------

# ----
# Export
panel = Panel("Test_1m_Platte_mit_Tasche_v.2")
path = FilePath("D:\Projekte\SynologyDrive\53_post-processor\test\")
c_script_7 = CSharpScript(
    folder=path,
    fileName=panel,
    export=Toggle(True),
    dx=number_slider_2,
    dy=number_slider_2,
    dz=Slider(19, range=0..100),
    operationLines=c_script_6)  # -> hopContent, statusMsg; inputs folder: String, fileName: String, export: Boolean, dx: Double, dy: Double, dz: Double, wzgv: String, operationLines: list of String
# ---------- c_script_7: C# ----------
// HopExport -- Core .hop file generator for DYNESTIC CNC
// Inputs: folder (Item), fileName (Item), export (Item), dx (Item), dy (Item), dz (Item),
//         wzgv (Item), operationLines (List)
// Outputs: hopContent, statusMsg
//
// folder   -- output directory, e.g. D:/Projekte/test/
// fileName -- file name without extension, e.g. Tisch_bohren
//
// Assembles and writes syntactically valid .hop files from GH inputs.
// Follows the kukaprc_toolpath.cs guard-default-work-output pattern.
// Phase 3+ operation components wire their List<string> output into operationLines.

using System;
using System.Collections;
using System.Collections.Generic;
using System.Drawing;
using System.IO;
using System.Text;
using System.Globalization;

using Rhino;
using Rhino.Geometry;

using Grasshopper;
using Grasshopper.Kernel;
using Grasshopper.Kernel.Data;
using Grasshopper.Kernel.Types;

public class Script_Instance : GH_ScriptInstance
{
  private void RunScript(
		string folder,
		string fileName,
		bool export,
		double dx,
		double dy,
		double dz,
		string wzgv,
		List<string> operationLines,
		ref object hopContent,
		ref object statusMsg)
  {
    // ---------------------------------------------------------------
    // 1. DEFAULTS -- downstream gets these if guards trigger
    // ---------------------------------------------------------------
    hopContent = "";
    statusMsg = "";

    // ---------------------------------------------------------------
    // 2. EXPORT GUARD -- silent return when not exporting
    // ---------------------------------------------------------------
    if (!export) return;

    // ---------------------------------------------------------------
    // 3. INPUT DEFAULTS -- fallback for disconnected inputs
    // ---------------------------------------------------------------
    if (dx <= 0) dx = 800.0;
    if (dy <= 0) dy = 400.0;
    if (dz <= 0) dz = 19.0;
    if (wzgv == null) wzgv = "7023K_681";

    // ---------------------------------------------------------------
    // 4. VALIDATION -- error messages for invalid required inputs
    // ---------------------------------------------------------------
    if (string.IsNullOrWhiteSpace(folder))
    {
      this.Component.AddRuntimeMessage(
        GH_RuntimeMessageLevel.Error, "folder is empty");
      return;
    }

    if (string.IsNullOrWhiteSpace(fileName))
    {
      this.Component.AddRuntimeMessage(
        GH_RuntimeMessageLevel.Error, "fileName is empty");
      return;
    }

    string directory = Path.GetFullPath(folder);

    if (!Directory.Exists(directory))
    {
      this.Component.AddRuntimeMessage(
        GH_RuntimeMessageLevel.Error, "Directory does not exist: " + directory);
      return;
    }

    // Strip .hop extension if user typed it, then re-add -- always clean
    string stem = fileName.EndsWith(".hop", StringComparison.OrdinalIgnoreCase)
      ? fileName.Substring(0, fileName.Length - 4)
      : fileName;

    string fullPath = Path.Combine(directory, stem + ".hop");

    if (operationLines == null)
    {
      operationLines = new List<string>();
    }

    // ---------------------------------------------------------------
    // 5. BUILD HEADER -- match Muster_DXF_Import.hop order exactly
    // ---------------------------------------------------------------
    string ncName = stem;

    List<string> lines = new List<string>();
    lines.Add(";MAKROTYP=0");
    lines.Add(";INSTVERSION=");
    lines.Add(";EXEVERSION=");
    lines.Add(";BILD=");
    lines.Add(";INFO=");

    // WZGV is conditional -- omit line entirely if empty string
    if (!string.IsNullOrEmpty(wzgv))
    {
      lines.Add(";WZGV=" + wzgv);
    }

    lines.Add(";WZGVCONFIG=");
    lines.Add(";MASCHINE=HOLZHER");
    lines.Add(";NCNAME=" + ncName);
    lines.Add(";KOMMENTAR=");
    lines.Add(";DX=0.000");
    lines.Add(";DY=0.000");
    lines.Add(";DZ=0");
    lines.Add(";DIALOGDLL=Dialoge.Dll");
    lines.Add(";DIALOGPROC=StandardFormAnzeigen");
    lines.Add(";AUTOSCRIPTSTART=1");
    lines.Add(";BUTTONBILD=");
    lines.Add(";DIMENSION_UNIT=0");

    // ---------------------------------------------------------------
    // 6. BUILD VARS BLOCK -- 3-space indent, InvariantCulture decimals
    // ---------------------------------------------------------------
    lines.Add("VARS");
    lines.Add("   DX := " + dx.ToString(CultureInfo.InvariantCulture) + ";*VAR*Dimension X");
    lines.Add("   DY := " + dy.ToString(CultureInfo.InvariantCulture) + ";*VAR*Dimension Y");
    lines.Add("   DZ := " + dz.ToString(CultureInfo.InvariantCulture) + ";*VAR*Dimension Z");

    // ---------------------------------------------------------------
    // 7. BUILD START SECTION -- Fertigteil + HH_Park
    // ---------------------------------------------------------------
    lines.Add("START");
    lines.Add("Fertigteil (DX,DY,DZ,0,0,0,0,0,'',0,0,0)");
    lines.Add("CALL HH_Park ( VAL PARK:=3,X:=0,Y:=0)");

    // ---------------------------------------------------------------
    // 8. INSERT OPERATION LINES -- Phase 3+ integration point
    // ---------------------------------------------------------------
    for (int i = 0; i < operationLines.Count; i++)
    {
      lines.Add(operationLines[i]);
    }

    // ---------------------------------------------------------------
    // 9. ASSEMBLE AND WRITE -- CRLF line endings, ASCII encoding
    // ---------------------------------------------------------------
    string content = string.Join("\r\n", lines) + "\r\n";
    File.WriteAllText(fullPath, content, Encoding.ASCII);

    // ---------------------------------------------------------------
    // 10. SUCCESS OUTPUT
    // ---------------------------------------------------------------
    this.Component.AddRuntimeMessage(
      GH_RuntimeMessageLevel.Remark, "Exported: " + fullPath);
    hopContent = content;
    statusMsg = "Exported: " + fullPath;
  }
}
# ---------- end c_script_7 ----------
panel_2 = Panel(c_script_7.hopContent)
panel_3 = Panel(c_script_7.statusMsg)
