# Grasshopper definition bench.gh (Grasshopper 1.0.8)
# plug-ins: Wallaby Hop

ln = Line(StartPoint=Point(-20, 200, 19), EndPoint=Point(620, 200, 19))
number_slider = Slider(3.2, range=1..20)
list = ValueList({"X-groove": 0, "Y-groove": 1}, selected="X-groove")
list_2 = ValueList({"Ebene 0": 0, "Ebene 1": 1}, selected="Ebene 0")
list_3 = ValueList({"Left": 1, "Center": 0, "Right": -1}, selected="Left")
crv = Curve()
pt = Point(Point(400, 300, 19))
pt_2 = Point(Point(0, 60, 9.5))
pt_3 = Point(Point(0, 100, 19))
hopsaw = HopSaw(
    DirLine=[crv, ln],
    BladeAngle=Slider(0, range=-90..90),
    Length=Slider(0, range=0..3000),
    SawKerf="3.2",
    Depth=Slider(19, range=1..100),
    Side=list_3,
    Extend=Slider(0, range=0..50),
    ToolNr=Slider(10, range=1..20),
    Colour=RGB(0, 191, 255))
hopdrill = HopDrill(
    Points=pt,
    Depth=Slider(13, range=0..100),
    Diameter=Slider(5, range=1..50),
    Stepdown=Slider(0, range=0..50),
    ToolNr=Slider(1, range=1..20),
    Colour=RGB(255, 0, 0))
hopfixchip = HopFixchip(Positions=pt_2, Angle=Slider(0, range=-360..360), Skippable=True)
hopgrooveslot = HopGrooveSlot(
    Direction=list,
    Position=pt_3,
    Width=[Slider(8, range=1..50), "8.2"],
    Depth=Slider(10, range=1..50),
    Ebene=list_2,
    ShortenStart=Slider(0, range=0..100),
    ShortenEnd=Slider(0, range=0..100),
    ToolNr=Slider(12, range=1..20),
    Colour=RGB(255, 165, 0))
planesrf = PlaneSurface(Plane=PlaneXY(0, 0, 0), XSize=Slider(900, range=0..1000), YSize=Slider(500, range=0..1000))
list_4 = ValueList({"Inside": 1, "Center": 0, "Outside": -1}, selected="Inside")
pt_4 = Point(Point(199.3488088, 183.986285, 0))
hopcircpath = HopCircPath(
    Center=pt_4,
    Radius=Slider(87, range=1..500),
    RadiusCorr=list_4,
    Depth=Slider(10, range=1..100),
    Stepdown=Slider(0, range=0..50),
    Angle=Slider(0, range=0..360),
    ToolNr=Slider(1, range=1..20),
    Colour=RGB(50, 205, 50))
merge = Merge(Data1=hopdrill, Data2=hopfixchip, Data3=hopsaw, Data4=hopgrooveslot, Data5=hopcircpath)
hopjob = HopJob(
    OperationLines=merge,
    DX=Slider(600, range=0..5000),
    DY=Slider(400, range=0..3000),
    DZ=Slider(19, range=1..100),
    WZGV="7023K_681")  # -> IsValid, Summary, Errors, Stats, HopContent
hopstocksim = HopStockSim(HopContent=hopjob.HopContent, Step=Slider(99, range=0..99))  # -> Stock, Steps, StepCount
hopbackplot = HopBackplot(HopContent=hopjob.HopContent, Show=True, TextSize=12)  # -> OpCount, ChainCount
hopstocksim_2 = HopStockSim(HopContent=hopjob.HopContent, Step=Slider(20, range=0..99))  # -> Stock, Steps, StepCount
cir = Circle(Plane=PlaneXY(0, 0, 0), Radius=60)
list_5 = ValueList({"X-cut (fixed Y)": 0, "Y-cut (fixed X)": 1}, selected="X-cut (fixed Y)")
list_6 = ValueList({"Front edge": 0, "Back edge": 1}, selected="Front edge")
list_7 = ValueList({"Inside": 1, "Center": 0, "Outside": -1}, selected="Inside")
list_8 = ValueList({"Left": 1, "Center": 0, "Right": -1}, selected="Left")
list_9 = ValueList({"X-row": 0, "Y-row": 1}, selected="X-row")
pt_5 = Point(Point(22.5, 100, 19))
crv_2 = Curve()
pt_6 = Point(Point(150, 150, 19))
pt_7 = Point(Point(200, 150, 19))
pt_8 = Point(Point(50, 50, 19))
pt_9 = Point(Point(250, 50, 19))
pt_10 = Point(Point(50, 100, 19))
pt_11 = Point(Point(300, 250, 19))
hopblumhinge = HopBlumHinge(
    Positions=pt_5,
    Distance=Slider(22.5, range=1..100),
    Side=list_6,
    CupDiameter=Slider(35, range=10..50),
    CupDepth=Slider(12.8, range=1..30),
    DowelDiameter=Slider(8, range=0..20),
    DowelDepth=Slider(13, range=0..30),
    ToolNr=Slider(1, range=1..20),
    Colour=RGB(147, 112, 219))
hopcontour = HopContour(
    Curve=[crv_2, cir],
    Depth=Slider(10, range=1..100),
    LeadIn=Slider(0, range=0..100),
    Tolerance=Slider(0.1, range=0.001..1),
    ToolNr=Slider(1, range=1..20),
    ToolDiameter=Slider(8, range=1..50),
    Side=list_8,
    Passes=Slider(0, range=0..50),
    Overcut=0,
    LeadOut=0,
    AutoFlip=False,
    CornerStyle=0,
    Colour=RGB(255, 255, 0))
hopcircpath_2 = HopCircPath(
    Center=pt_6,
    Radius=Slider(25, range=1..500),
    RadiusCorr=list_7,
    Depth=Slider(10, range=1..100),
    Stepdown=Slider(0, range=0..50),
    Angle=Slider(0, range=0..360),
    ToolNr=Slider(1, range=1..20),
    Colour=RGB(50, 205, 50))
hopcircpocket = HopCircPocket(
    Center=pt_7,
    Radius=Slider(25, range=1..500),
    Depth=Slider(10, range=1..100),
    Stepdown=Slider(0, range=0..50),
    ToolNr=Slider(1, range=1..20),
    Colour=RGB(0, 255, 255))
hopfreeslot = HopFreeSlot(
    P1=pt_8,
    P2=pt_9,
    SlotWidth=Slider(8, range=1..50),
    Depth=Slider(10, range=0..100),
    ToolNr=Slider(1, range=1..20),
    Colour=RGB(255, 165, 0))
hopdrillrow = HopDrillRow(
    Direction=list_9,
    StartPoint=pt_10,
    Spacings=Slider(32, range=0..500),
    Depth=Slider(13, range=1..50),
    Diameter=Slider(5, range=1..50),
    Mirror=False,
    ToolNr=Slider(1, range=1..20),
    Colour=RGB(255, 99, 71))
hopformatcut = HopFormatCut(
    Direction=list_5,
    Position=pt_11,
    Thickness=Slider(19, range=1..100),
    KW=Slider(0, range=-90..90),
    Length=Slider(0, range=0..3000),
    ToolNr=Slider(1, range=1..20),
    Colour=RGB(30, 144, 255))
